# Grasshopper definition Crossection_Material_testing.gh (Grasshopper 1.0.7)
# plug-ins: Karamba, karambaToSofistik

srf = Surface(<surface referenced from the Rhino model>)  # disabled
mesh = Mesh(srf)  # disabled
matselect = MaterialSelectionKaramba3D(menu=[dropdown(3), dropdown(2)])  # disabled
matprops = MaterialPropertiesKaramba3D(
    FamilyOfMaterial="Steel",
    Name="S235",
    YoungsModulus_kN_cm2=21000,
    InPlaneShearModulus_kN_cm2=8076,
    TransverseShearModulus_kN_cm2=8076,
    SpecificWeight_kN_m3=78.5,
    CoefficientOfThermalExpansion_1_C=1e-05,
    YieldStrength_kN_cm2=23.5,
    mode="Isotrop")  # disabled
matprops_2 = MaterialPropertiesKaramba3D(
    FamilyOfMaterial="Steel",
    Name="S235",
    YoungsModulus_kN_cm2=21000,
    InPlaneShearModulus_kN_cm2=8076,
    TransverseShearModulus_kN_cm2=8076,
    SpecificWeight_kN_m3=78.5,
    CoefficientOfThermalExpansion_1_C=1e-05,
    YieldStrength_kN_cm2=23.5,
    mode="Isotrop")  # disabled
meshtoshell = MeshToShellKaramba3D(Mesh=mesh, LimitDistance_m=0.005)  # -> Element, Points, Info; disabled
crv = Curve([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])  # disabled
item = ListItem(List=crv, Index=0, Wrap=True)  # disabled
cross_section = CrossSectionKaramba3D(
    FamilyNameOfCrossSection="DefaultCroSec",
    Material=matprops,
    Diameter_cm=11.43,
    WallThickness_cm=0.4,
    mode="Circular Hollow")  # disabled
cross_section_2 = CrossSectionKaramba3D(
    FamilyNameOfCrossSection="DefaultCroSec",
    Material=matprops_2,
    Height_cm=9.6,
    UpperFlangeWidth_cm=10,
    LowerFlangeWidth_cm=10,
    UpperFlangeThickness_cm=0.8,
    LowerFlangeThickness_cm=0.8,
    WebThickness_cm=0.5,
    FilletRadius_cm=0,
    mode="I")  # disabled
cross_section_3 = CrossSectionKaramba3D(
    FamilyNameOfCrossSection="DefaultCroSec",
    Material=matselect,
    Height_cm=9.6,
    UpperFlangeWidth_cm=10,
    LowerFlangeWidth_cm=10,
    UpperFlangeThickness_cm=0.8,
    LowerFlangeThickness_cm=0.8,
    WebThickness_cm=0.5,
    FilletRadius_cm=0,
    mode="I")  # disabled
linetobeam = LineToBeamKaramba3D(Line=crv, CrossSection=cross_section, New=True, Remove=True, LimitDistance_m=0.005)  # -> Element, Points, Info; disabled
crv_2 = Curve(item)  # disabled
end = EndPoints(Curve=crv_2)  # -> Start, End; disabled
supp = SupportKaramba3D(PosInd=end.End, menu=[buttons(on, on, on, on, on, on)])  # disabled
number_slider = Slider(0.2, range=0..1)  # disabled
number_slider_2 = Slider(0.2, range=0..1)  # disabled
number_slider_3 = Slider(0.2, range=0..1)  # disabled
linetobeam_2 = LineToBeamKaramba3D(Line=crv_2, CrossSection=cross_section_3, New=True, Remove=True, LimitDistance_m=0.005)  # -> Element, Points, Info; disabled
cross_section_4 = CrossSectionKaramba3D(FamilyNameOfCrossSection="DefaultCroSec", mode="Spring")  # disabled
Z = UnitZ(Factor=number_slider)  # disabled
Y = UnitY(Factor=1)  # disabled
panel = Panel("2")  # disabled
Z_2 = UnitZ(Factor=number_slider_2)  # disabled
panel_2 = Panel("18")  # disabled
Z_3 = UnitZ(Factor=number_slider_3)  # disabled
panel_3 = Panel("1")  # disabled
number_slider_4 = Slider(1.4, range=0..10)  # disabled
Z_4 = UnitZ(Factor=number_slider_4)  # disabled
loads = LoadsKaramba3D(ForceVector=Z, Local=False, PosInd=[end.Start, end.End], LCase=panel, mode="Point")  # disabled
panel_4 = Panel("3")  # disabled
loads_2 = LoadsKaramba3D(ForceVector=Z_2, Local=False, PosInd=[end.Start, end.End], LCase=panel_2, mode="Point")  # disabled
loads_3 = LoadsKaramba3D(ForceVector=Z_3, Local=False, PosInd=[end.Start, end.End], LCase=panel_3, mode="Point")  # disabled
panel_5 = Panel("""2
3
4""")  # disabled
loads_4 = LoadsKaramba3D(Vector=Z_4, BeamIdentifiers=panel_5, LCase=panel_4, mode="Uniform Line", menu=[buttons(on, off, off)])  # disabled
panel_6 = Panel("2")  # disabled
pt = Point([Point(12.27182831, 14.97443729, -0.02955650405), Point(12.27182831, 0.0414951468, -0.02955650405), Point(0, 0.0414951468, -0.02955650405), Point(0, 14.97443729, -0.02955650405)])
loads_5 = LoadsKaramba3D(Vector=Vector(0, 0, -1), LCase=panel_6, mode="Gravity")  # disabled
assemble = AssembleModelKaramba3D(
    Elem=flatten([linetobeam.Element, linetobeam_2.Element]),
    Support=flatten(supp),
    Load=[loads, loads_3, loads_2, loads_5, loads_4],
    CrossSection=cross_section_2,
    LimitDistance_m=0.005)  # -> Model, Info, Mass_kg, CenterOfGravity; disabled
supp_2 = SupportKaramba3D(PosInd=pt, menu=[buttons(on, on, on, on, on, on)])
crv_3 = Curve([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])
loads_6 = LoadsKaramba3D(Vector=Vector(0, 0, -1), LCase="1", mode="Gravity")
linetobeam_3 = LineToBeamKaramba3D(Line=crv_3, New=True, Remove=True, LimitDistance_m=0.005)  # -> Element, Points, Info
pt_2 = Point([Point(0, 14.97443729, 9.858472754), Point(12.27182831, 14.97443729, 9.858472754), Point(0, 0.0414951468, 9.858472754), Point(12.27182831, 0.0414951468, 9.858472754)])
Z_5 = UnitZ(Factor=Slider(20, range=0..100))
crosecselect = CrossSectionSelectorKaramba3D(NameOrListIndexOfCrossSection="IPE400")  # -> CrossSection, Info
loads_7 = LoadsKaramba3D(ForceVector=Z_5, Local=False, PosInd=flatten(pt_2), LCase="1", mode="Point")  # -> flatten(Load)
assemble_2 = AssembleModelKaramba3D(
    Elem=flatten(linetobeam_3.Element),
    Support=flatten(supp_2),
    Load=loads_7,
    CrossSection=crosecselect.CrossSection,
    LimitDistance_m=0.005)  # -> Model, Info, Mass_kg, CenterOfGravity
analyze = AnalyzeKaramba3D(Model=assemble_2.Model)  # -> CalculatedModel, MaximumDisplacement_cm, ResultingForceOfGravity_kN, ElasticEnergy_kNm
karsof = KarambaToSofistik(Model=assemble_2.Model)  # -> Sofistik, Log
modelview = ModelViewKaramba3D(Model=analyze.CalculatedModel, LoadCaseFactorsForLinearSuperposition=1, IndexOfVisibleLoadcase=-1)  # -> Model, DeformedMesh, DeformedAxes, DeformedModel
beamview = BeamViewKaramba3D(Model=modelview.Model)  # -> Model, MeshesOfRenderedBeams, DeformedBeamAxes, LegendColors, LegendTags
panel_7 = Panel(karsof.Sofistik)
panel_8 = Panel(karsof.Log)
b_res_force = BeamResultantForcesKaramba3D(AnalyzedModel=beamview.Model, LoadCase=-1, MaximumProbingDistance_m=-1, NumberOfProbingPointsPerElement=3)  # -> AnalyzedModel, flatten(NormalForce_kN), ResultantBendingMoment_kNm, ResultantShearForce_kN
panel_9 = Panel(b_res_force.NormalForce_kN)
calc_sof = CalculateSofistik(Sofistik=panel_7, Calculate=Button(), SolverOptions="2")
timer = Timer(TimerInterval=1000, Target=calc_sof_2)
calc_sof_2 = CalculateSofistik(Sofistik=calc_sof)  # -> BeamForces, Status
panel_10 = Panel(calc_sof_2.Status)
panel_11 = Panel(calc_sof_2.BeamForces)
